# Grasshopper definition short impulse.gh (Grasshopper 0.9.76)
# plug-ins: Kangaroo Components

pt = Point(<point referenced from the Rhino model>)
pt_2 = Point(<point referenced from the Rhino model>)

pt_3 = Point(<point referenced from the Rhino model>)
particle = Particle(Point=pt_3, Mass=Slider(3.6, range=0..10), Velocity=Vector(0, 0, 0))

pt_4 = Point(<point referenced from the Rhino model>)
particle_2 = Particle(Point=pt_4, Mass=Slider(4.2, range=0..10), Velocity=Vector(0, 0, 0))
sc = SphereCollide(Centers=[pt_4, pt, pt_3], Radius=Slider(0.5, range=0..1))

number_slider = Slider(10, range=0..10)
neg = Negative(Value=Slider(3, range=0..10))
inter = InterconnectPoints(Pts=[pt_2, pt])
Y = UnitY(Factor=Slider(3, range=0..3))
plaw = PowerLaw(Connection=inter, Exponents="0", Strength=neg, Cutoff=0)
particle_3 = Particle(Point=pt, Mass=number_slider, Velocity=Y)
anchorxyz = AnchorXYZ(Point=pt_2, ConstrainX=True, ConstrainY=True, ConstrainZ=True)
toggle = BooleanToggle(True)
kangaroo_settings = KangarooSettings(
    Tolerance=0.001,
    TimeStep=0.01,
    SubIterations=10,
    Floor=False,
    Drag=Slider(0, range=0..1),
    Restitution=0.7,
    StaticFriction=10,
    KineticFriction=10,
    Settle=2,
    Tumble=1,
    Sound=False,
    Solver=0)
timer = Timer(TimerInterval=1, Target=kangaroo)
kangaroo = KangarooPhysics(
    ForceObjects=[anchorxyz, plaw, particle_3, sc, particle_2, particle],
    Settings=kangaroo_settings,
    Geometry=[pt_2, pt],
    SimulationReset=toggle)  # -> Out, Iterations, graft(ParticlesOut), GeometryOut, KE
bang = ExplodeTree(Data=kangaroo.ParticlesOut)  # -> Branch0, Branch1, Branch2, Branch3
dispatch = Dispatch(List=kangaroo.GeometryOut, DispatchPattern=[True, False])  # -> ListA, ListB
panel = Panel("""Asteroid
10""")
move = Move(Geometry=bang.Branch0, Motion=Vector(1, 1, 0))  # -> Geometry, Transform
swatch = ColourSwatch(SwatchColor=RGB(255, 200, 0))
sph = Sphere(Base=bang.Branch3, Radius=3)
sph_2 = Sphere(Base=bang.Branch0, Radius=1)
T = Trail(Points=dispatch.ListB, Reset=toggle, Record=True)
tag = TextTag3D(Location=move.Geometry, Text=panel, Size=Slider(2, range=0..2), Justification=7)
dist = Distance(PointA=dispatch.ListA, PointB=dispatch.ListB)
preview = CustomPreview(Geometry=sph, Shader=swatch)
preview_2 = CustomPreview(Geometry=sph_2, Shader=ColourSwatch(SwatchColor=RGB(150, 150, 150)))
move_2 = Move(Geometry=bang.Branch3, Motion=Vector(2, 2, 0))  # -> Geometry, Transform
explode = Explode(Curve=T, Recursive=True)  # -> Segments, Vertices
радиус_условной_арбиты = Panel(dist)
len = Length(Curve=explode.Segments)
скорость = Panel(len)
multiplication = Multiplication(A=скорость, B=скорость)
number_slider_2 = Slider(1.2, range=0..10)
multiplication_2 = Multiplication(A=multiplication, B=number_slider)
pt_5 = Point(bang.Branch2)
pt_6 = Point(bang.Branch1)
tag_2 = TextTag3D(Location=move_2.Geometry, Text="Sun", Size=Slider(2, range=0..2), Colour=swatch, Justification=7)
panel_2 = Panel("""Propellana
mass
3.6""")
panel_3 = Panel("""Propellana
mass
4.2""")
division = Division(A=multiplication_2, B=2)
move_3 = Move(Geometry=pt_5, Motion=Vector(2, 2, 0))  # -> Geometry, Transform
move_4 = Move(Geometry=pt_6, Motion=Vector(2, 2, 0))  # -> Geometry, Transform
кинетическая_энергия = Panel(division)
tag_3 = TextTag3D(Location=move_3.Geometry, Text=panel_2, Size=number_slider_2, Justification=9)
tag_4 = TextTag3D(Location=move_4.Geometry, Text=panel_3, Size=number_slider_2, Justification=9)
lng = ListLength(List=кинетическая_энергия)
multiplication_3 = Multiplication(A=кинетическая_энергия, B=Slider(30, range=0..100))
series = Series(Start=0, Step=0.1, Count=lng)
pt_7 = ConstructPoint(XCoordinate=series, YCoordinate=multiplication_3, ZCoordinate=0)
pline = PolyLine(Vertices=pt_7, Closed=False)
