# Grasshopper definition weak impulse.gh (Grasshopper 0.9.76)
# plug-ins: Kangaroo Components

pt = Point(<point referenced from the Rhino model>)
pt_2 = Point(<point referenced from the Rhino model>)
number_slider = Slider(10, range=0..10)
neg = Negative(Value=Slider(3, range=0..10))
inter = InterconnectPoints(Pts=[pt_2, pt])
Y = UnitY(Factor=Slider(3, range=0..3))
plaw = PowerLaw(Connection=inter, Exponents="0", Strength=neg, Cutoff=0)
particle = Particle(Point=pt, Mass=number_slider, Velocity=Y)
kangaroo_settings = KangarooSettings(
    Tolerance=0.001,
    TimeStep=0.01,
    SubIterations=10,
    Floor=False,
    Drag=Slider(0, range=0..2),
    Restitution=0.7,
    StaticFriction=10,
    KineticFriction=10,
    Settle=2,
    Tumble=1,
    Sound=False,
    Solver=0)
anchorxyz = AnchorXYZ(Point=pt_2, ConstrainX=True, ConstrainY=True, ConstrainZ=True)
toggle = BooleanToggle(True)
timer = Timer(TimerInterval=1, Target=kangaroo)
kangaroo = KangarooPhysics(ForceObjects=[anchorxyz, plaw, particle], Settings=kangaroo_settings, Geometry=[pt_2, pt], SimulationReset=toggle)  # -> Out, Iterations, graft(ParticlesOut), GeometryOut, KE
bang = ExplodeTree(Data=kangaroo.ParticlesOut)  # -> Branch0, Branch1, Branch2, Branch3
dispatch = Dispatch(List=kangaroo.GeometryOut, DispatchPattern=[True, False])  # -> ListA, ListB
swatch = ColourSwatch(SwatchColor=RGB(255, 200, 0))
sph = Sphere(Base=bang.Branch1, Radius=3)
T = Trail(Points=dispatch.ListB, Reset=toggle, Record=True)
panel = Panel("""Asteroid
10""")
move = Move(Geometry=bang.Branch0, Motion=Vector(1, 1, 0))  # -> Geometry, Transform
dist = Distance(PointA=dispatch.ListA, PointB=dispatch.ListB)
preview = CustomPreview(Geometry=sph, Shader=swatch)
sph_2 = Sphere(Base=bang.Branch0, Radius=1)
move_2 = Move(Geometry=bang.Branch1, Motion=Vector(2, 2, 0))  # -> Geometry, Transform
explode = Explode(Curve=T, Recursive=True)  # -> Segments, Vertices
радиус_условной_арбиты = Panel(dist)
tag = TextTag3D(Location=move.Geometry, Text=panel, Size=Slider(2, range=0..2), Justification=7)
preview_2 = CustomPreview(Geometry=sph_2, Shader=ColourSwatch(SwatchColor=RGB(150, 150, 150)))
len = Length(Curve=explode.Segments)
скорость = Panel(len)
multiplication = Multiplication(A=скорость, B=скорость)
multiplication_2 = Multiplication(A=multiplication, B=number_slider)
tag_2 = TextTag3D(Location=move_2.Geometry, Text="Sun", Size=Slider(2, range=0..2), Colour=swatch, Justification=7)
division = Division(A=multiplication_2, B=2)
кинетическая_энергия = Panel(division)
lng = ListLength(List=кинетическая_энергия)
multiplication_3 = Multiplication(A=кинетическая_энергия, B=Slider(100, range=0..100))
series = Series(Start=0, Step=0.1, Count=lng)
pt_3 = ConstructPoint(XCoordinate=series, YCoordinate=multiplication_3, ZCoordinate=0)
pline = PolyLine(Vertices=pt_3, Closed=False)
